% Simulink data dictionary diode.sldd

I = [-0.019; -0.018; -0.017; -0.016; -0.015; -0.014; -0.013; -0.012; -0.011; -0.01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 7.6]
V = [-19.35; -18.56; -17.81; -17.01; -16.32; -15.11; -13.93; -12.77; -11.94; -10.34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 0.68]